# Grasshopper definition hops_hui.gh (Grasshopper 1.0.7)
# plug-ins: Weaverbird, Hops

deconstruct_mesh = DeconstructMesh()  # -> Vertices, Faces, Colours, Normals; disabled
trigger = Trigger(Interval=-1000, TimerInterval=1000, Target=hops)  # disabled
deconstruct = Deconstruct(Point=deconstruct_mesh.Vertices)  # -> flatten(XComponent), flatten(YComponent), flatten(ZComponent); disabled
deconstruct_face = DeconstructFace(Face=deconstruct_mesh.Faces)  # -> flatten(CornerA), flatten(CornerB), flatten(CornerC), flatten(CornerD); disabled
local = Panel("http://localhost:5000/processVF")  # disabled
hops = Hops(
    _Path=local,
    Vx=deconstruct.XComponent,
    Vy=deconstruct.YComponent,
    Vz=deconstruct.ZComponent,
    F1=deconstruct_face.CornerA,
    F2=deconstruct_face.CornerB,
    F3=deconstruct_face.CornerC,
    F4=deconstruct_face.CornerD,
    CacheResultsInMemory=False,
    CacheSolveResults=False,
    RemoteDefinitionLocation="http://localhost:5000/processVF",
    RemoteSolveVersion=(0, 1, 0),
    ShowInput_Enabled=False,
    ShowInput_Path=True,
    SynchronousSolve=True)  # disabled

mesh = Mesh(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)
local_2 = Panel("http://localhost:5000/processMesh")
mine = Panel("http://127.0.0.1:5000/processMesh")
florian_s = Panel("http://10.68.74.6:5000/processMesh")
# Inputs
local_3 = Panel("http://localhost:5000/read_1mesh")

# ---- group: Iterations
# Guided Projection Algorithm Settings
iter = Slider(5, range=5..20)

# ---- group: weight_fairness
fairness = Panel("0.01")
fairness_2 = Panel("0.005")
fairness_3 = Panel("0.0005")
number = Number(fairness_2)

# ---- group: weight_self-closeness
closness_2 = Panel("0")
number_2 = Number(closness_2)

# ---- group: eps
epsilon = Panel("0.001")
number_3 = Number(epsilon)

# ----
local_4 = Panel("http://localhost:5000/read_mesh")

# ---- group: a1gnet2_2g+voss+asy_unitscale
mesh_2 = Mesh(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)

# ---- group: input quadmesh
mesh_3 = Mesh(mesh_2)

# ---- group: 1st or 2nd poly
number_slider = Slider(0, range=0..1)

# ----
panel = Panel("AGG")
panel_2 = Panel("GGA")

panel_3 = Panel("GAA")
panel_4 = Panel("AAG")

panel_5 = Panel("GGAA")

panel_6 = Panel("Anet")
panel_7 = Panel("AnetDiagnet")

panel_8 = Panel("Gnet")
panel_9 = Panel("GnetDiagnet")

local_5 = Panel("http://localhost:5000/arrayss")

# ---- group: 1st or 2nd poly
number_slider_2 = Slider(0, range=0..1)

# ----
a_net_diag = BooleanToggle(False)
a_net = BooleanToggle(False)

g_net_diag = BooleanToggle(False)
g_net = BooleanToggle(False)

number_slider_3 = Slider(10, range=0..10)

gga = BooleanToggle(False)
agg = BooleanToggle(False)

aag = BooleanToggle(False)
gaa = BooleanToggle(False)

aagg = BooleanToggle(False)
ggaa = BooleanToggle(True)

# ---- group: Optimize
trigger_2 = Trigger(Interval=-1000, TimerInterval=1000, Target=hops_2)

# ----
trigger_3 = Trigger(Interval=-1000, TimerInterval=1000)

panel_10 = Panel("AAGG")
restart = BooleanToggle(False)

# ----
# Process
hops_2 = Hops(
    _Path=local_3,
    Mesh=mesh_3,
    Iter=iter,
    Fairness=number,
    Closness=number_2,
    Direction=number_slider,
    Web=panel_10,
    Restart=False,
    CacheResultsInMemory=False,
    CacheSolveResults=False,
    RemoteDefinitionLocation="http://localhost:5000/read_1mesh",
    RemoteSolveVersion=(0, 1, 0),
    ShowInput_Enabled=False,
    ShowInput_Path=True,
    SynchronousSolve=True)  # -> Mesh, An, Vn
hops_3 = Hops(
    _Path=local_5,
    CacheResultsInMemory=False,
    CacheSolveResults=False,
    RemoteDefinitionLocation="http://localhost:5000/arrayss",
    RemoteSolveVersion=(0, 1, 0),
    ShowInput_Enabled=False,
    ShowInput_Path=True,
    SynchronousSolve=True)

# ---- group: output quadmesh
# Outputs
mesh_4 = Mesh(hops_2.Mesh)

# ----
# Optimized mesh vertex-normals
weaverbird_s_mesh_edges = WeaverbirdsMeshEdges(MeshOrPolylines=mesh_4)
length = Length(Curve=weaverbird_s_mesh_edges)
# Visulization
average = Average(Input=length)
amplitude = Amplitude(Vector=hops_2.Vn, Amplitude=average)
addition = Addition(A=hops_2.An, B=amplitude)
line = Line(StartPoint=hops_2.An, EndPoint=addition)

# ----
# checker vertices
local_6 = Panel("http://localhost:5000/checker_tian_vertex")
trigger_4 = Trigger(Interval=-1000, TimerInterval=1000, Target=hops_4)
hops_4 = Hops(
    _Path=local_6,
    Mesh=mesh_4,
    CacheResultsInMemory=False,
    CacheSolveResults=False,
    RemoteDefinitionLocation="http://localhost:5000/checker_tian_vertex",
    RemoteSolveVersion=(0, 1, 0),
    ShowInput_Enabled=False,
    ShowInput_Path=True,
    SynchronousSolve=True)  # -> P1, P2
point = Point(hops_4.P1)
point_2 = Point(hops_4.P2)

# ----
# control_points + Bezier_splines
control_points = Point()
nurbs_curve = NurbsCurve(Vertices=control_points, Degree="5", Periodic=False)  # -> Curve, Length, Domain

local_7 = Panel("http://localhost:5000/lines")
panel_11 = Panel("""0.5
1
1.5""")
line_2 = Line(Line((-1, 0, 0), (-1, 3, 0)))
hops_5 = Hops(
    _Path=local_7,
    Line=line_2,
    I=panel_11,
    CacheResultsInMemory=False,
    CacheSolveResults=False,
    RemoteDefinitionLocation="http://localhost:5000/lines",
    RemoteSolveVersion=(0, 1, 0),
    ShowInput_Enabled=False,
    ShowInput_Path=True,
    SynchronousSolve=True)
panel_12 = Panel(hops_5)

nurbs_curve_pwk = NurbsCurvePWK()  # -> Curve, Length, Domain
connect_curves = ConnectCurves(Continuity=2, Close=True, Bulge=1)
